# Grasshopper definition Appserver1.gh (Grasshopper 1.0.7)

# HOUSE POSITION
number_slider = Slider(8, range=8..20)

# ---- group: Size of panel(cm)
number_slider_2 = Slider(122, range=0..122)
number_slider_3 = Slider(0, range=0..20)

# ----
no_of_panels_1 = GetInteger(number_slider, AtLeast=1, AtMost=2147483647, Maximum=359, Minimum=0)
no_of_panels_2 = GetInteger(Slider(8, range=8..20), AtLeast=1, AtMost=2147483647, Maximum=359, Minimum=0)
series = Series(Start=number_slider_3, Step=number_slider_2, Count=no_of_panels_1)
series_2 = Series(Start=number_slider_3, Step=number_slider_2, Count=no_of_panels_2)
sort = SortList(Keys=series_2)  # -> Keys, ValuesA
sort_2 = SortList(Keys=series)  # -> Keys, ValuesA
rev = ReverseList(List=sort.Keys)
rev_2 = ReverseList(List=sort_2.Keys)
item = ListItem(List=rev, Index=0, Wrap=True)
item_2 = ListItem(List=rev_2, Index=0, Wrap=True)
division = Division(A=item, B=2)
division_2 = Division(A=item_2, B=2)
pt = Point(Point(1170, 3493, 0))
box = CenterBox(Base=pt, X=division, Y=division_2, Z="150")
pdecon = Deconstruct(Point=pt)  # -> XComponent, YComponent, ZComponent
Z = UnitZ(Factor="150")
pt_2 = ConstructPoint(XCoordinate=pdecon.XComponent, YCoordinate=pdecon.YComponent, ZCoordinate=0)
move = Move(Geometry=box, Motion=Z)  # -> Geometry, Transform
rotation = GetInteger(Slider(0, range=0..359), AtLeast=1, AtMost=2147483647, Maximum=359, Minimum=0)
rotate = Rotate(Geometry=move.Geometry, Angle=degrees(rotation), Plane=pt_2)  # -> Geometry, Transform
debrep = DeconstructBrep(Brep=rotate.Geometry)  # -> Faces, Edges, Vertices
area = Area(Geometry=debrep.Faces)  # -> Area, Centroid
pdecon_2 = Deconstruct(Point=area.Centroid)  # -> XComponent, YComponent, ZComponent
sort_3 = SortList(Keys=pdecon_2.ZComponent)  # -> Keys, ValuesA
rev_3 = ReverseList(List=sort_3.Keys)
item_3 = ListItem(List=rev_3, Index=0, Wrap=True)
larger = LargerThan(FirstNumber=pdecon_2.ZComponent, SecondNumber=item_3)  # -> LargerThan, OrEqualTo
dispatch = Dispatch(List=debrep.Faces, DispatchPattern=larger.OrEqualTo)  # -> ListA, ListB
dispatch_2 = Dispatch(List=area.Centroid, DispatchPattern=larger.OrEqualTo)  # -> ListA, ListB
scale = Scale(Geometry=dispatch.ListA, Center=dispatch_2.ListA, Factor="1.1")  # -> Geometry, Transform
Z_2 = UnitZ(Factor="50")
extr = Extrude(Base=scale.Geometry, Direction=Z_2)

# ---- group: RH_OUT:walls
# Important toggle
# NOTE
final_geometry = Geometry(rotate.Geometry)

# ---- group: RH_OUT:Roof_base
# TITLE
# GENERATIVE OUTPUT
# ERROR
# QUESTION
# OUTPUT
# INPUT
# 5. Point-in-time Illuminance
# Illuminance
# 4. Daylight Autonomy
# sDA - no blinds
# (Spatial Daylight Autonomy)
# sDA
# DA
# 6. Annual Sunlight Exposure
# ASE
# ASE
# ASE
custom_preview = CustomPreview(
    Geometry=extr,
    Material={diffuse=RGB(221, 160, 221), emission=RGB(66, 48, 66), shine=0.5, specular=RGB(255, 255, 255), transparency=0})
